# Grasshopper definition debug_1.gh (Grasshopper 1.0.7)
# plug-ins: TwinLand Info, Test, Heron

trigger = Trigger(Interval=1000, TimerInterval=1000, Target=consolelogger)  # disabled
consolelogger = ConsoleLogger(Update=Toggle(True), Clear=Button())
restgeocode = RESTGeocode(Addresses="University of Virginia")  # -> Candidates, Latitude, Longtitude
panel = Panel(consolelogger)
list = ValueList({"ESRI World Imagery": "https://server.arcgisonline.com/ArcGIS/rest/services/World_Imagery/MapServer/export?", "ESRI World Topo Map": "https://server.arcgisonline.com/arcgis/rest/services/World_Topo_Map/MapServer/export?", "ESRI World Physical Map": "https://server.arcgisonline.com/arcgis/rest/services/World_Physical_Map/MapServer/export?", "ESRI World Street Map": "https://server.arcgisonline.com/arcgis/rest/services/World_Street_Map/MapServer/export?", "ESRI World Terrain Base": "https://server.arcgisonline.com/arcgis/rest/services/World_Terrain_Base/MapServer/export?", "ESRI World Shaded Relief": "https://server.arcgisonline.com/arcgis/rest/services/World_Shaded_Relief/MapServer/export?", "ESRI World Dark Gray Base": "https://server.arcgisonline.com/arcgis/rest/services/Canvas/World_Dark_Gray_Base/MapServer/export?", "ESRI World Light Gray Base": "https://server.arcgisonline.com/arcgis/rest/services/Canvas/World_Light_Gray_Base/MapServer/export?", "ESRI World Hillshade": "https://server.arcgisonline.com/arcgis/rest/services/Elevation/World_Hillshade/MapServer/export?", "ESRI World Hillshade Dark": "https://server.arcgisonline.com/arcgis/rest/services/Elevation/World_Hillshade_Dark/MapServer/export?", "ESRI World Boundaries and Places": "https://server.arcgisonline.com/arcgis/rest/services/Reference/World_Boundaries_and_Places/MapServer/export?", "ESRI World Transportation": "https://server.arcgisonline.com/arcgis/rest/services/Reference/World_Transportation/MapServer/export?", "ESRI DeLorme World Base Map": "https://server.arcgisonline.com/arcgis/rest/services/Specialty/DeLorme_World_Base_Map/MapServer/export?", "ESRI NatGeo World Map": "https://server.arcgisonline.com/arcgis/rest/services/NatGeo_World_Map/MapServer/export?", "ESRI USA Topo Maps": "https://server.arcgisonline.com/arcgis/rest/services/USA_Topo_Maps/MapServer/export?"}, selected="ESRI World Imagery")
usgs_raster = ValueList({"USGS Topo": "https://basemap.nationalmap.gov/arcgis/rest/services/USGSTopo/MapServer/export?", "USGS Imagery Only": "https://basemap.nationalmap.gov/arcgis/rest/services/USGSImageryOnly/MapServer/export?", "USGS 3DEP Bare Earth DEM": "https://elevation.nationalmap.gov/arcgis/rest/services/3DEPElevation/ImageServer/exportImage?", "USGS 3DEP Hillshade Gray": "https://elevation.nationalmap.gov/arcgis/rest/services/3DEPElevation/ImageServer/exportImage?renderingRule={%22rasterFunction%22 : %22Hillshade Gray%22}&", "USGS 3DEP Aspect Map": "https://elevation.nationalmap.gov/arcgis/rest/services/3DEPElevation/ImageServer/exportImage?renderingRule={%22rasterFunction%22 : %22Aspect Map%22}&", "USGS 3DEP Hillshade Elevation Tinted": "https://elevation.nationalmap.gov/arcgis/rest/services/3DEPElevation/ImageServer/exportImage?renderingRule={%22rasterFunction%22 : %22Hillshade Elevation Tinted%22}&", "USGS 3DEP Grey Hillshade Elevation Fill": "https://elevation.nationalmap.gov/arcgis/rest/services/3DEPElevation/ImageServer/exportImage?renderingRule={%22rasterFunction%22 : %22GreyHillshade_elevationFill%22}&", "USGS 3DEP Hillshade Multidirectional": "https://elevation.nationalmap.gov/arcgis/rest/services/3DEPElevation/ImageServer/exportImage?renderingRule={%22rasterFunction%22 : %22Hillshade Multidirectional%22}&", "USGS 3DEP Slope Map": "https://elevation.nationalmap.gov/arcgis/rest/services/3DEPElevation/ImageServer/exportImage?renderingRule={%22rasterFunction%22 : %22Slope Map%22}&"}, selected="USGS Topo")
number_slider = Slider(200, range=0..1000)
esri_raster = ValueList({"ESRI World Imagery": "https://server.arcgisonline.com/ArcGIS/rest/services/World_Imagery/MapServer/export?", "ESRI World Topo Map": "https://server.arcgisonline.com/arcgis/rest/services/World_Topo_Map/MapServer/export?", "ESRI World Physical Map": "https://server.arcgisonline.com/arcgis/rest/services/World_Physical_Map/MapServer/export?", "ESRI World Street Map": "https://server.arcgisonline.com/arcgis/rest/services/World_Street_Map/MapServer/export?", "ESRI World Terrain Base": "https://server.arcgisonline.com/arcgis/rest/services/World_Terrain_Base/MapServer/export?", "ESRI World Shaded Relief": "https://server.arcgisonline.com/arcgis/rest/services/World_Shaded_Relief/MapServer/export?", "ESRI World Dark Gray Base": "https://server.arcgisonline.com/arcgis/rest/services/Canvas/World_Dark_Gray_Base/MapServer/export?", "ESRI World Light Gray Base": "https://server.arcgisonline.com/arcgis/rest/services/Canvas/World_Light_Gray_Base/MapServer/export?", "ESRI World Hillshade": "https://server.arcgisonline.com/arcgis/rest/services/Elevation/World_Hillshade/MapServer/export?", "ESRI World Hillshade Dark": "https://server.arcgisonline.com/arcgis/rest/services/Elevation/World_Hillshade_Dark/MapServer/export?", "ESRI World Boundaries and Places": "https://server.arcgisonline.com/arcgis/rest/services/Reference/World_Boundaries_and_Places/MapServer/export?", "ESRI World Transportation": "https://server.arcgisonline.com/arcgis/rest/services/Reference/World_Transportation/MapServer/export?", "ESRI DeLorme World Base Map": "https://server.arcgisonline.com/arcgis/rest/services/Specialty/DeLorme_World_Base_Map/MapServer/export?", "ESRI NatGeo World Map": "https://server.arcgisonline.com/arcgis/rest/services/NatGeo_World_Map/MapServer/export?", "ESRI USA Topo Maps": "https://server.arcgisonline.com/arcgis/rest/services/USA_Topo_Maps/MapServer/export?"}, selected="ESRI World Imagery")
resolution = ValueList({"None": , "Low": 256, "Med": 512, "High": 1024, "Max": 2048}, selected="Max")
panel_2 = Panel("/Users/jiaqizheng/Documents/Projects/Grasshopper Development/TwinLand/Gh_TestFiles/temp")
c_script = CSharpScript()  # -> out, A
# ---------- c_script: C# usings ----------
using Rhino.DocObjects;
# ---------- c_script: C# ----------
EarthAnchorPoint ePt = RhinoDoc.ActiveDoc.EarthAnchorPoint;

A = ePt.EarthBasepointLatitude;
# ---------- end c_script ----------
item = ListItem(List=flatten(restgeocode.Latitude), Index=0, Wrap=True)
item_2 = ListItem(List=flatten(restgeocode.Longtitude), Index=0, Wrap=True)
rectanglecentertest = RectangleCenterTest(Plane=PlaneXY(0, 0, 0), XSize=number_slider, YSize=number_slider, Radius=1)  # -> Rectangle, Length
panel_3 = Panel(c_script.A)
panel_4 = Panel(item)
panel_5 = Panel(item_2)
seteap = SetEarthAnchorPoint(Set=Toggle(True), Latitude=item, Longitude=item_2)
restraster = GetRESTRaster(
    Boundary=rectanglecentertest.Rectangle,
    Resolution=resolution,
    TargetFolder=panel_2,
    Prefix="test",
    RESTURL=list,
    Run=Toggle(True),
    UserSpatialReferenceSystem="WGS84",
    ImageType="jpg")  # -> Image, ImageFrame, RESTQuery
panel_6 = Panel(restgeocode.Candidates)
panel_7 = Panel(seteap)
esri_raster_2 = ValueList({"ESRI World Imagery": "https://server.arcgisonline.com/ArcGIS/rest/services/World_Imagery/MapServer/export?", "ESRI World Topo Map": "https://server.arcgisonline.com/arcgis/rest/services/World_Topo_Map/MapServer/export?", "ESRI World Physical Map": "https://server.arcgisonline.com/arcgis/rest/services/World_Physical_Map/MapServer/export?", "ESRI World Street Map": "https://server.arcgisonline.com/arcgis/rest/services/World_Street_Map/MapServer/export?", "ESRI World Terrain Base": "https://server.arcgisonline.com/arcgis/rest/services/World_Terrain_Base/MapServer/export?", "ESRI World Shaded Relief": "https://server.arcgisonline.com/arcgis/rest/services/World_Shaded_Relief/MapServer/export?", "ESRI World Dark Gray Base": "https://server.arcgisonline.com/arcgis/rest/services/Canvas/World_Dark_Gray_Base/MapServer/export?", "ESRI World Light Gray Base": "https://server.arcgisonline.com/arcgis/rest/services/Canvas/World_Light_Gray_Base/MapServer/export?", "ESRI World Hillshade": "https://server.arcgisonline.com/arcgis/rest/services/Elevation/World_Hillshade/MapServer/export?", "ESRI World Hillshade Dark": "https://server.arcgisonline.com/arcgis/rest/services/Elevation/World_Hillshade_Dark/MapServer/export?", "ESRI World Boundaries and Places": "https://server.arcgisonline.com/arcgis/rest/services/Reference/World_Boundaries_and_Places/MapServer/export?", "ESRI World Transportation": "https://server.arcgisonline.com/arcgis/rest/services/Reference/World_Transportation/MapServer/export?", "ESRI DeLorme World Base Map": "https://server.arcgisonline.com/arcgis/rest/services/Specialty/DeLorme_World_Base_Map/MapServer/export?", "ESRI NatGeo World Map": "https://server.arcgisonline.com/arcgis/rest/services/NatGeo_World_Map/MapServer/export?", "ESRI USA Topo Maps": "https://server.arcgisonline.com/arcgis/rest/services/USA_Topo_Maps/MapServer/export?"}, selected="ESRI World Imagery")
esri_raster_3 = ValueList({"ESRI World Imagery": "https://server.arcgisonline.com/ArcGIS/rest/services/World_Imagery/MapServer/export?", "ESRI World Topo Map": "https://server.arcgisonline.com/arcgis/rest/services/World_Topo_Map/MapServer/export?", "ESRI World Physical Map": "https://server.arcgisonline.com/arcgis/rest/services/World_Physical_Map/MapServer/export?", "ESRI World Street Map": "https://server.arcgisonline.com/arcgis/rest/services/World_Street_Map/MapServer/export?", "ESRI World Terrain Base": "https://server.arcgisonline.com/arcgis/rest/services/World_Terrain_Base/MapServer/export?", "ESRI World Shaded Relief": "https://server.arcgisonline.com/arcgis/rest/services/World_Shaded_Relief/MapServer/export?", "ESRI World Dark Gray Base": "https://server.arcgisonline.com/arcgis/rest/services/Canvas/World_Dark_Gray_Base/MapServer/export?", "ESRI World Light Gray Base": "https://server.arcgisonline.com/arcgis/rest/services/Canvas/World_Light_Gray_Base/MapServer/export?", "ESRI World Hillshade": "https://server.arcgisonline.com/arcgis/rest/services/Elevation/World_Hillshade/MapServer/export?", "ESRI World Hillshade Dark": "https://server.arcgisonline.com/arcgis/rest/services/Elevation/World_Hillshade_Dark/MapServer/export?", "ESRI World Boundaries and Places": "https://server.arcgisonline.com/arcgis/rest/services/Reference/World_Boundaries_and_Places/MapServer/export?", "ESRI World Transportation": "https://server.arcgisonline.com/arcgis/rest/services/Reference/World_Transportation/MapServer/export?", "ESRI DeLorme World Base Map": "https://server.arcgisonline.com/arcgis/rest/services/Specialty/DeLorme_World_Base_Map/MapServer/export?", "ESRI NatGeo World Map": "https://server.arcgisonline.com/arcgis/rest/services/NatGeo_World_Map/MapServer/export?", "ESRI USA Topo Maps": "https://server.arcgisonline.com/arcgis/rest/services/USA_Topo_Maps/MapServer/export?"}, selected="ESRI World Imagery")
