# Grasshopper definition FilterOSM.gh (Grasshopper 1.0.7)
# plug-ins: TwinLand

merge = Merge(Data1="natural=water", Data2="natural=heath", Data3="natural=scrub", Data4="natural=beach", Data5="natural=sand")
importosm = ImportOSM(
    Boundary=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,
    FilePath="/Users/jiaqizheng/Desktop/temp/osmFile.osm",
    OSMTag_KeyValue=merge,
    Clipped=True)  # -> Extends, Fields, Values, FeatureGeometry
path_mapper = PathMapper(importosm.FeatureGeometry, source=["{A;B}", "{A;B;C}"], target=["{A;B}", "{A;B}"])
featurematcher = FeatureMatcher(featuregeometry=path_mapper, tag_value=importosm.Values, osm_tag_value="natural=water")
featurematcher_2 = FeatureMatcher(featuregeometry=path_mapper, tag_value=importosm.Values, osm_tag_value="natural=heath")
featurematcher_3 = FeatureMatcher(featuregeometry=path_mapper, tag_value=importosm.Values, osm_tag_value="natural=scrub")
featurematcher_4 = FeatureMatcher(featuregeometry=path_mapper, tag_value=importosm.Values, osm_tag_value="natural=beach")
featurematcher_5 = FeatureMatcher(featuregeometry=path_mapper, tag_value=importosm.Values, osm_tag_value="natural=sand")

# ---- group: 1. Decimal Degrees Mode
list = ValueList({"Indiana Dunes": "41.670178, -87.041603", "Warren Dunes": "41.906936, -86.603696", "Saugatuck Dunes": "42.679693, -86.204491", "Silver Lake Dunes": "43.678330, -86.519065", "Arcadia Dunes": "44.527073, -86.229063", "Sleeping Bear Dunes": "44.892975, -86.057554", "Sturgeon Bay Dunes": "45.687958, -84.968681"}, selected="Warren Dunes")
panel = Panel(list)
deconstructlocation = DeconstructLocation(Location=list)  # -> Latitude, Longitude
seteap = SetEarthAnchorPoint(Set=Button(), Latitude=deconstructlocation.Latitude, Longitude=deconstructlocation.Longitude)

# ----
filterosm = FilterOpenStreetMap(FeatureGeometry=path_mapper, Values=importosm.Values, OSM_Tag_KeyValue="natural=water")

# ==== cluster FeatureMatcher
osm_tag_value = ClusterInput()  # OSM query format for example, Tag=Value
split = TextSplit(Text=osm_tag_value, Separators="=")
item = ListItem(List=reverse(split), Index=0, Wrap=True)
tag_value = ClusterInput()  # Tag’s value from imported OSM file
textequality = CSharpScript(T1=tag_value, T2=item)  # -> out, A; inputs T1: String, T2: String
# ---------- textequality: C# ----------
A = String.Equals(T1, T2);
# ---------- end textequality ----------
ma = MassAddition(Input=textequality.A)  # -> Result, PartialResults
featuregeometry = ClusterInput()  # FeatureGeometry
cull = CullPattern(List=featuregeometry, CullPattern=ma.Result)
filteredgeometry = ClusterOutput(cull)  # FilteredGeometry
