# Grasshopper definition GetRaster.gh (Grasshopper 1.0.7)
# plug-ins: TwinLand

number_slider = Slider(800, range=0..10000)

# ---- group: 1. Decimal Degrees Mode
list = ValueList({"Indiana Dunes": "41.670178, -87.041603", "Warren Dunes": "41.906936, -86.603696", "Saugatuck Dunes": "42.679693, -86.204491", "Silver Lake Dunes": "43.678330, -86.519065", "Arcadia Dunes": "44.527073, -86.229063", "Sleeping Bear Dunes": "44.892975, -86.057554", "Sturgeon Bay Dunes": "45.687958, -84.968681"}, selected="Warren Dunes")
panel = Panel(list)
deconstructlocation = DeconstructLocation(Location=list)  # -> Latitude, Longitude
seteap = SetEarthAnchorPoint(Set=Button(), Latitude=deconstructlocation.Latitude, Longitude=deconstructlocation.Longitude)

# ----
dom = ConstructDomain(DomainStart=expr("-x", number_slider), DomainEnd=number_slider)
list_2 = ValueList({"ESRI World Imagery": "https://server.arcgisonline.com/ArcGIS/rest/services/World_Imagery/MapServer/export?", "ESRI World Topo Map": "https://server.arcgisonline.com/arcgis/rest/services/World_Topo_Map/MapServer/export?", "ESRI World Physical Map": "https://server.arcgisonline.com/arcgis/rest/services/World_Physical_Map/MapServer/export?", "ESRI World Street Map": "https://server.arcgisonline.com/arcgis/rest/services/World_Street_Map/MapServer/export?", "ESRI World Terrain Base": "https://server.arcgisonline.com/arcgis/rest/services/World_Terrain_Base/MapServer/export?", "ESRI World Shaded Relief": "https://server.arcgisonline.com/arcgis/rest/services/World_Shaded_Relief/MapServer/export?", "ESRI World Dark Gray Base": "https://server.arcgisonline.com/arcgis/rest/services/Canvas/World_Dark_Gray_Base/MapServer/export?", "ESRI World Light Gray Base": "https://server.arcgisonline.com/arcgis/rest/services/Canvas/World_Light_Gray_Base/MapServer/export?", "ESRI World Hillshade": "https://server.arcgisonline.com/arcgis/rest/services/Elevation/World_Hillshade/MapServer/export?", "ESRI World Hillshade Dark": "https://server.arcgisonline.com/arcgis/rest/services/Elevation/World_Hillshade_Dark/MapServer/export?", "ESRI World Boundaries and Places": "https://server.arcgisonline.com/arcgis/rest/services/Reference/World_Boundaries_and_Places/MapServer/export?", "ESRI World Transportation": "https://server.arcgisonline.com/arcgis/rest/services/Reference/World_Transportation/MapServer/export?", "ESRI DeLorme World Base Map": "https://server.arcgisonline.com/arcgis/rest/services/Specialty/DeLorme_World_Base_Map/MapServer/export?", "ESRI NatGeo World Map": "https://server.arcgisonline.com/arcgis/rest/services/NatGeo_World_Map/MapServer/export?", "ESRI USA Topo Maps": "https://server.arcgisonline.com/arcgis/rest/services/USA_Topo_Maps/MapServer/export?"}, selected="ESRI World Imagery")
resolution = ValueList({"None": , "Low": 256, "Med": 512, "High": 1024, "Max": 2048}, selected="Max")
rectangle = Rectangle(Plane=PlaneXY(0, 0, 0), XSize=dom, YSize=dom, Radius=0)  # -> Rectangle, Length
getraster = GetRaster(
    Boundary=rectangle.Rectangle,
    Resolution=resolution,
    FolderPath="/Users/jiaqizheng/Desktop/temp",
    FileName="test",
    ServiceURL=list_2,
    Get=Toggle(True),
    SpatialReferenceSystem="WGS84",
    ImageType="jpg")  # -> ImagePath, ImageExtent, REST_query
cleanmissingcomponents = CleanMissingComponents(Run=Button())
