# Grasshopper definition PublicSand_0916.gh (Grasshopper 1.0.7)
# plug-ins: Human, Pufferfish, TwinLand

# ---- group: 2. AutoMode
list = ValueList({"Indiana Dunes": "Wabash Ave, Porter, IN 46304", "Warren Dunes": "12032 Red Arrow Hwy, Sawyer, MI 49125", "Saugatuck Dunes": "6575 138th Ave, Holland, MI 49423", "Silver Lake Dunes": "9679 W State Park Rd, Mears, MI 49436", "Arcadia Dunes": "Gilbert Rd, Arcadia, MI 49613", "Sleeping Bear Dunes": "Sleeping Bear Dr, Glen Arbor, MI 49636"}, selected="Indiana Dunes")
restgeocode = RESTGeocode(Addresses=list)  # -> Candidates, Latitude, Longitude
panel = Panel(restgeocode.Candidates)
item = ListItem(List=flatten(restgeocode.Latitude), Index=0, Wrap=True)
item_2 = ListItem(List=flatten(restgeocode.Longitude), Index=0, Wrap=True)
seteap = SetEarthAnchorPoint(Set=Button(), Latitude=item, Longitude=item_2)
panel_2 = Panel(seteap)

# ---- group: 1. Decimal Degrees Mode
list_2 = ValueList({"Indiana Dunes": "41.670178, -87.041603", "Warren Dunes": "41.906936, -86.603696", "Saugatuck Dunes": "42.679693, -86.204491", "Silver Lake Dunes": "43.678330, -86.519065", "Arcadia Dunes": "44.527073, -86.229063", "Sleeping Bear Dunes": "44.892975, -86.057554", "Sturgeon Bay Dunes": "45.687958, -84.968681"}, selected="Indiana Dunes")
panel_3 = Panel(list_2)
deconstructlocation = DeconstructLocation(Location=list_2)  # -> Latitude, Longitude
seteap_2 = SetEarthAnchorPoint(Set=Button(), Latitude=deconstructlocation.Latitude, Longitude=deconstructlocation.Longitude)

# ---- group: 3. Manual Mode
xyz_dd = PointToDecimalDegrees(Point=Point(-50.78314229, 539.2828636, 0))  # -> Latitude, Longitude
seteap_3 = SetEarthAnchorPoint(Set=Button(), Latitude=xyz_dd.Latitude, Longitude=xyz_dd.Longitude)
panel_4 = Panel(seteap_3)

# ---- group: generate
toggle = BooleanToggle(True)

# ---- group: boundary
docunits = ConvertToDocumentUnits(ValueString="2000m")
neg = Negative(Value=docunits)
dom = ConstructDomain(DomainStart=docunits, DomainEnd=neg)
rectangle = Rectangle(Plane=PlaneXY(0, 0, 0), XSize=dom, YSize=dom, Radius=0)  # -> Rectangle, Length
gate = StreamGate(Stream=rectangle.Rectangle, Gate=toggle)  # -> Target0, Target1

# ----
usgs_raster = ValueList({"USGS Topo": "https://basemap.nationalmap.gov/arcgis/rest/services/USGSTopo/MapServer/export?", "USGS Imagery Only": "https://basemap.nationalmap.gov/arcgis/rest/services/USGSImageryOnly/MapServer/export?", "USGS 3DEP Bare Earth DEM": "https://elevation.nationalmap.gov/arcgis/rest/services/3DEPElevation/ImageServer/exportImage?", "USGS 3DEP Hillshade Gray": "https://elevation.nationalmap.gov/arcgis/rest/services/3DEPElevation/ImageServer/exportImage?renderingRule={%22rasterFunction%22 : %22Hillshade Gray%22}&", "USGS 3DEP Aspect Map": "https://elevation.nationalmap.gov/arcgis/rest/services/3DEPElevation/ImageServer/exportImage?renderingRule={%22rasterFunction%22 : %22Aspect Map%22}&", "USGS 3DEP Hillshade Elevation Tinted": "https://elevation.nationalmap.gov/arcgis/rest/services/3DEPElevation/ImageServer/exportImage?renderingRule={%22rasterFunction%22 : %22Hillshade Elevation Tinted%22}&", "USGS 3DEP Grey Hillshade Elevation Fill": "https://elevation.nationalmap.gov/arcgis/rest/services/3DEPElevation/ImageServer/exportImage?renderingRule={%22rasterFunction%22 : %22GreyHillshade_elevationFill%22}&", "USGS 3DEP Hillshade Multidirectional": "https://elevation.nationalmap.gov/arcgis/rest/services/3DEPElevation/ImageServer/exportImage?renderingRule={%22rasterFunction%22 : %22Hillshade Multidirectional%22}&", "USGS 3DEP Slope Map": "https://elevation.nationalmap.gov/arcgis/rest/services/3DEPElevation/ImageServer/exportImage?renderingRule={%22rasterFunction%22 : %22Slope Map%22}&"}, selected="USGS Topo")
esri_raster = ValueList({"ESRI World Imagery": "https://server.arcgisonline.com/ArcGIS/rest/services/World_Imagery/MapServer/export?", "ESRI World Topo Map": "https://server.arcgisonline.com/arcgis/rest/services/World_Topo_Map/MapServer/export?", "ESRI World Physical Map": "https://server.arcgisonline.com/arcgis/rest/services/World_Physical_Map/MapServer/export?", "ESRI World Street Map": "https://server.arcgisonline.com/arcgis/rest/services/World_Street_Map/MapServer/export?", "ESRI World Terrain Base": "https://server.arcgisonline.com/arcgis/rest/services/World_Terrain_Base/MapServer/export?", "ESRI World Shaded Relief": "https://server.arcgisonline.com/arcgis/rest/services/World_Shaded_Relief/MapServer/export?", "ESRI World Dark Gray Base": "https://server.arcgisonline.com/arcgis/rest/services/Canvas/World_Dark_Gray_Base/MapServer/export?", "ESRI World Light Gray Base": "https://server.arcgisonline.com/arcgis/rest/services/Canvas/World_Light_Gray_Base/MapServer/export?", "ESRI World Hillshade": "https://server.arcgisonline.com/arcgis/rest/services/Elevation/World_Hillshade/MapServer/export?", "ESRI World Hillshade Dark": "https://server.arcgisonline.com/arcgis/rest/services/Elevation/World_Hillshade_Dark/MapServer/export?", "ESRI World Boundaries and Places": "https://server.arcgisonline.com/arcgis/rest/services/Reference/World_Boundaries_and_Places/MapServer/export?", "ESRI World Transportation": "https://server.arcgisonline.com/arcgis/rest/services/Reference/World_Transportation/MapServer/export?", "ESRI DeLorme World Base Map": "https://server.arcgisonline.com/arcgis/rest/services/Specialty/DeLorme_World_Base_Map/MapServer/export?", "ESRI NatGeo World Map": "https://server.arcgisonline.com/arcgis/rest/services/NatGeo_World_Map/MapServer/export?", "ESRI USA Topo Maps": "https://server.arcgisonline.com/arcgis/rest/services/USA_Topo_Maps/MapServer/export?"}, selected="ESRI World Imagery")
panel_5 = Panel("/Users/jiaqizheng/Desktop/temp/")
resolution = ValueList({"None": , "Low": 256, "Med": 512, "High": 1024, "Max": 2048}, selected="Max")

# ---- group: boundary
input_boundary_curve_s = Curve(gate.Target1)

# ----
list_3 = ValueList({"Aerialway": "aerialway", "Aeroway": "aeroway", "Amenity": "amenity", "Barrier": "barrier", "Boundary": "boundary", "Building": "building", "Craft": "craft", "Emergency": "emergency", "Geological": "geological", "Healthcare": "healthcare", "Highway": "highway", "Historic": "historic", "Landuse": "landuse", "Leisure": "leisure", "Man made": "man made", "Military": "military", "Natural": "natural", "Office": "office", "Place": "place", "Power": "power", "Public transport": "public transport", "Railway": "railway", "Route": "route", "Shop": "shop", "Sport": "sport", "Telecom": "telecom", "Tourism": "tourism", "Water": "water", "Waterway": "waterway"}, selected="Natural")
getosm = GetOpenStreetMap(
    Boundary=input_boundary_curve_s,
    TargetFolder=panel_5,
    FileName="osmFile",
    OSMTag_Key=list_3,
    Run=Toggle(True),
    OSMService="Overpass API")  # -> OpenStreetMapFile, OpenStreetMapQuery
merge = Merge(Data1="natural=water", Data2="natural=heath", Data3="natural=scrub", Data4="natural=beach", Data5="natural=sand")
importosm = ImportOSM(Boundary=input_boundary_curve_s, FilePath=getosm.OpenStreetMapFile, OSMTag_KeyValue=merge, Clipped=True)  # -> Extends, Fields, Values, FeatureGeometry
path_mapper = PathMapper(importosm.FeatureGeometry, source=["{A;B}", "{A;B;C}"], target=["{A;B}", "{A;B}"])
filterosm = FilterOpenStreetMap(FeatureGeometry=path_mapper, Values=importosm.Values, OSM_Tag_KeyValue="natural=water")
filterosm_2 = FilterOpenStreetMap(FeatureGeometry=path_mapper, Values=importosm.Values, OSM_Tag_KeyValue="natural=heath")
filterosm_3 = FilterOpenStreetMap(FeatureGeometry=path_mapper, Values=importosm.Values, OSM_Tag_KeyValue="natural=scrub")
filterosm_4 = FilterOpenStreetMap(FeatureGeometry=path_mapper, Values=importosm.Values, OSM_Tag_KeyValue="natural=beach")
filterosm_5 = FilterOpenStreetMap(FeatureGeometry=path_mapper, Values=importosm.Values, OSM_Tag_KeyValue="natural=sand")

gettopo = GetTopo(
    Boundary=input_boundary_curve_s,
    TargetFolder=panel_5,
    FileName="topo",
    Run=toggle,
    Source_DEM="USGS 3DEP Bare Earth DEM Max")  # -> DEM_FilePath, TopoQuery
nickname = ImportTopo(Boundary=input_boundary_curve_s, DEM=gettopo.DEM_FilePath, Clip=True)  # -> DEM_Mesh, DEM_Extent, DEM_Info

number_slider = Slider(30, range=0..1000)
division = Division(A=docunits, B=number_slider)
area = Area(Geometry=input_boundary_curve_s)  # -> Area, Centroid
scale = Scale(Geometry=input_boundary_curve_s, Center=area.Centroid, Factor=0.98)  # -> Geometry, Transform
range = Range(Domain=Domain(0, 1), Steps=division)
paramptdivsrf = ParameterPointDivideSurface(Surface=scale.Geometry, ParametersU=range, ParametersV=range)  # -> Points, Normals
Z = UnitZ(Factor=1)
project = ProjectPoint(Point=paramptdivsrf.Points, Direction=Z, Geometry=nickname.DEM_Mesh)  # -> flatten(Point), Index
srfgrid = SurfaceFromPoints(Points=project.Point, UCount=expr("x+1", division), Interpolate=False)
topobrep = Data(srfgrid)

getraster = GetRaster(
    Boundary=input_boundary_curve_s,
    Resolution=resolution,
    FolderPath=panel_5,
    FileName="aerial",
    ServiceURL=esri_raster,
    Get=toggle,
    SpatialReferenceSystem="WGS84",
    ImageType="jpg")  # -> ImagePath, ImageExtent, REST_query
multiplication = Multiplication(A=docunits, B=1)
division_2 = Division(A=multiplication, B=number_slider)

surfacemap = SurfaceMapping(Mesh=nickname.DEM_Mesh, Surface=nickname.DEM_Extent)
previewmat = CustomPreviewMaterials(Geometry=surfacemap, DiffuseColor=RGB(255, 254, 254), Transparency=0.3, DiffuseBitmap=getraster.ImagePath)

contour = Contour(Shape=topobrep, Point=Point(0, 0, 0), Direction=Vector(0, 0, 1), Distance=Slider(2, range=0..100))
previewlw = CustomPreviewLineweights(Geometry=contour, Shader=ColourSwatch(SwatchColor=RGB(150, 150, 150)), Thickness=1, Absolute=False)

multiplication_2 = Multiplication(A=docunits, B=2.2)
Z_2 = UnitZ(Factor=multiplication_2)
move = Move(Geometry=gate.Target1, Motion=Z_2)  # -> Geometry, Transform

incurves = PointInCurves(Point=project.Point, Curves=flatten(filterosm))  # -> Relationship, Index, Point; disabled
incurves_2 = PointInCurves(Point=project.Point, Curves=flatten(filterosm_2))  # -> Relationship, Index, Point; disabled
incurves_3 = PointInCurves(Point=project.Point, Curves=flatten(filterosm_4))  # -> Relationship, Index, Point; disabled
cull = CullPattern(List=project.Point, CullPattern=incurves_3.Relationship)  # disabled
cull_2 = CullPattern(List=project.Point, CullPattern=incurves_2.Relationship)  # disabled
cull_3 = CullPattern(List=project.Point, CullPattern=incurves.Relationship)  # disabled

paramcrvdivsrf = ParameterCurveDivideSurface(Surface=scale.Geometry, ParametersU=range, ParametersV=range)  # -> CurvesU, CurvesV
project_2 = Project(Curve=[paramcrvdivsrf.CurvesU, paramcrvdivsrf.CurvesV], Brep=topobrep, Direction=Vector(0, 0, 1))
previewlw_2 = CustomPreviewLineweights(Geometry=project_2, Shader=ColourSwatch(SwatchColor=RGB(115, 115, 115)), Thickness=1, Absolute=False)

twinland = Surface(move.Geometry)

cluster = Cluster(geometryfeature=filterosm, topobrep=topobrep, lift=1)
cluster_2 = Cluster(geometryfeature=filterosm_2, topobrep=topobrep, lift=2)
cluster_3 = Cluster(geometryfeature=filterosm_3, topobrep=topobrep, lift=3)
cluster_4 = Cluster(geometryfeature=filterosm_4, topobrep=topobrep, lift=5)
cluster_5 = Cluster(geometryfeature=filterosm_5, topobrep=topobrep, lift=2)

swatch = ColourSwatch(SwatchColor=RGB(255, 234, 0))
swatch_2 = ColourSwatch(SwatchColor=RGB(0, 106, 255))
swatch_3 = ColourSwatch(SwatchColor=RGB(0, 255, 8))
swatch_4 = ColourSwatch(SwatchColor=RGB(0, 145, 0))
swatch_5 = ColourSwatch(SwatchColor=RGB(255, 255, 255))
previewlw_3 = CustomPreviewLineweights(Geometry=[cull_3, cluster], Shader=swatch_2, Thickness=2, Absolute=False)
previewlw_4 = CustomPreviewLineweights(Geometry=[cull_2, cluster_2], Shader=swatch_3, Thickness=2, Absolute=False)
previewlw_5 = CustomPreviewLineweights(Geometry=[cull, cluster_3], Shader=swatch_4, Thickness=2, Absolute=False)
previewlw_6 = CustomPreviewLineweights(Geometry=[cull, cluster_4], Shader=swatch, Thickness=2, Absolute=False)
previewlw_7 = CustomPreviewLineweights(Geometry=[cull, cluster_5], Shader=swatch_5, Thickness=2, Absolute=False)

# ---- group: beach
project_3 = Project(Geometry=filterosm_4, Plane=twinland)  # -> Geometry, Transform
previewlw_8 = CustomPreviewLineweights(Geometry=project_3.Geometry, Shader=swatch, Absolute=False)

# ---- group: sand
project_4 = Project(Geometry=filterosm_5, Plane=twinland)  # -> Geometry, Transform
previewlw_9 = CustomPreviewLineweights(Geometry=project_4.Geometry, Shader=swatch_5, Absolute=False)

# ---- group: scrub
project_5 = Project(Geometry=filterosm_3, Plane=twinland)  # -> Geometry, Transform
previewlw_10 = CustomPreviewLineweights(Geometry=project_5.Geometry, Shader=swatch_4, Absolute=False)

# ---- group: lake & land
project_6 = Project(Geometry=filterosm, Plane=twinland)  # -> Geometry, Transform
previewlw_11 = CustomPreviewLineweights(Geometry=project_6.Geometry, Shader=swatch_2, Thickness=2, Absolute=False)

# ---- group: heath
project_7 = Project(Geometry=filterosm_2, Plane=twinland)  # -> Geometry, Transform
previewlw_12 = CustomPreviewLineweights(Geometry=project_7.Geometry, Shader=swatch_3, Absolute=False)

# ----
project_8 = ProjectPoint(Point=paramptdivsrf.Points, Direction=Z, Geometry=twinland)  # -> flatten(Point), Index

paramcrvdivsrf_2 = ParameterCurveDivideSurface(Surface=twinland, ParametersU=range, ParametersV=range)  # -> CurvesU, CurvesV
previewlw_13 = CustomPreviewLineweights(
    Geometry=[paramcrvdivsrf_2.CurvesU, paramcrvdivsrf_2.CurvesV],
    Shader=ColourSwatch(SwatchColor=RGB(115, 115, 115)),
    Thickness=1,
    Absolute=False)

runion = RegionUnion(Curves=flatten([project_4.Geometry, project_3.Geometry]))
area_2 = Area(Geometry=runion)  # -> Area, Centroid
ma = MassAddition(Input=flatten(area_2.Area))  # -> Result, PartialResults

runion_2 = RegionUnion(Curves=flatten([project_7.Geometry, project_5.Geometry, project_3.Geometry, project_4.Geometry]))
area_3 = Area(Geometry=runion_2)  # -> Area, Centroid
ma_2 = MassAddition(Input=flatten(area_3.Area))  # -> Result, PartialResults

division_3 = Division(A=ma.Result, B=ma_2.Result)
panel_6 = Panel(division_3)

pt = ConstructPoint(XCoordinate=0, YCoordinate=0, ZCoordinate=Z_2)
range_2 = Range(Domain=Domain(0, 1), Steps=16)

multiplication_3 = Multiplication(A=docunits, B=0.8)
sph = Sphere(Base=PlaneXY(0, 0, 0), Radius=multiplication_3)
range_3 = Range(Domain=Domain(0, 1), Steps=8)
paramcrvdivsrf_3 = ParameterCurveDivideSurface(Surface=sph, ParametersU=range_2, ParametersV=range_3)  # -> CurvesU, CurvesV

sph_2 = Sphere(Base=pt, Radius=multiplication_3)
paramcrvdivsrf_4 = ParameterCurveDivideSurface(Surface=sph_2, ParametersU=range_2, ParametersV=range_3)  # -> CurvesU, CurvesV

previewlw_14 = CustomPreviewLineweights(
    Geometry=[paramcrvdivsrf_4.CurvesU, paramcrvdivsrf_4.CurvesV, paramcrvdivsrf_3.CurvesU, paramcrvdivsrf_3.CurvesV],
    Shader=ColourSwatch(SwatchColor=RGB(105, 105, 105)),
    Thickness=1,
    Absolute=False)

# ==== cluster Cluster
geometryfeature = ClusterInput()  # GeometryFeature
topobrep = ClusterInput()  # TopoBrep
lift = ClusterInput()  # Lift
project = Project(Curve=geometryfeature, Brep=topobrep, Direction=Vector(0, 0, 1))
Z = UnitZ(Factor=lift)
move = Move(Geometry=project, Motion=Z)  # -> Geometry, Transform
projection = ClusterOutput(move.Geometry)  # Projection
